vi "Client Server Example.gvi"   [LabVIEW NXG 4.0.0]
panel indicators:
  "Read Data": string
uses:
  WebSockets::WebSocket Client.gtype::New Client.gvi
  WebSockets::WebSocket.gtype::Handshake.gvi
  WebSockets::WebSocket.gtype::Write Text.gvi
  WebSockets::WebSocket.gtype::Read Text.gvi
  Sockets::VISA TCP Listener.gtype::New VISA TCP Listener.gvi
  Sockets::VISA TCP Listener.gtype::Create Listener.gvi
  Sockets::VISA TCP Listener.gtype::Wait on Listener.gvi
  Sockets::VISA TCP Listener.gtype::Close.gvi
  WebSockets::WebSocket Server.gtype::New Server from Socket.gvi
  WebSockets::WebSocket.gtype::Close.gvi
diagram:
  call "New Client.gvi"(webSocket URL="ws://localhost:7890", timeout ms=5000) -> (webSocket client out=w1, error out=w2)
  call "Handshake.gvi"(webSockets in=w1, timeout ms=5000, error in=w2) -> (webSockets out=w3, error out=w4)
  # A very simple client example for the WebSockets API
  call "Write Text.gvi"(webSocket in=w3, string data="Hello world!", timeout ms=5000, error in=w4) -> (webSocket out=w5, error out=w6)
  call "Read Text.gvi"(webSocket in=w5, timeout ms=5000, error in=w6) -> (webSocket out=w7, data=w8, error out=w9)
  $"Read Data" <- w8
  call "New VISA TCP Listener.gvi"() -> (VISA TCP listener out=w10, error out=w11)
  call "Create Listener.gvi"(VISA TCP listener in=w10, port=7890, timeout ms=5000, error in=w11) -> (VISA TCP listener out=w12, error out=w13)
  call "Wait on Listener.gvi"(VISA TCP listener in=w12, timeout ms=5000, error in=w13) -> (VISA TCP listener out=w14, socket out=w15, error out=w16)
  call "Close.gvi"(VISA TCP listener in=w14, error in=w16) -> (error out=w17)
  call "New Server from Socket.gvi"(socket=w15, error in=w17) -> (webSocket server out=w18, error out=w19)
  call "Handshake.gvi"(webSockets in=w18, error in=w19) -> (webSockets out=w20, error out=w21)
  call "Read Text.gvi"(webSocket in=w20, error in=w21) -> (webSocket out=w22, data=w23)
  call "Write Text.gvi"(webSocket in=w22, string data=w23) -> (webSocket out=w24, error out=w25)
  call "Close.gvi"(webSocket in=w24, error in=w25) -> (error out=w26)
  call "Close.gvi"(webSocket in=w7, timeout ms=5000, error in=w9) -> (error out=w27)
  Merge Errors(w27, w26)
