vi "Simple Client Example.gvi"   [LabVIEW NXG 4.0.0]
panel controls:
  "WebSockets URL": string = "ws://echo.websocket.org"
  "Write Data": string = "Hello world!"
panel indicators:
  "Read Data": string
uses:
  WebSockets::WebSocket Client.gtype::New Client.gvi
  WebSockets::WebSocket.gtype::Handshake.gvi
  WebSockets::WebSocket.gtype::Write Text.gvi
  WebSockets::WebSocket.gtype::Read Text.gvi
  WebSockets::WebSocket.gtype::Close.gvi
diagram:
  call "New Client.gvi"(webSocket URL=$"WebSockets URL", timeout ms=5000) -> (webSocket client out=w1, error out=w2)
  call "Handshake.gvi"(webSockets in=w1, timeout ms=5000, error in=w2) -> (webSockets out=w3, error out=w4)
  # A very simple client example for the WebSockets API
  call "Write Text.gvi"(webSocket in=w3, string data=$"Write Data", timeout ms=5000, error in=w4) -> (webSocket out=w5, error out=w6)
  call "Read Text.gvi"(webSocket in=w5, timeout ms=5000, error in=w6) -> (webSocket out=w7, data=w8, error out=w9)
  $"Read Data" <- w8
  call "Close.gvi"(webSocket in=w7, timeout ms=5000, error in=w9)
