vi "Create Listener.gvi"   [LabVIEW Conversion 4.0.0]
# Creates a new TCP listener on the requested port.
# WebSockets 2.0.1.40
# Sam Sharp - MediaMongrels Ltd
# Copyright (c) 2019, MediaMongrels Ltd
inputs:
  "VISA TCP listener in": "VISA TCP Listener.gtype"
  "port": u16, required
  "timeout ms": i32 = 5000
  "error in": error
outputs:
  "VISA TCP listener out": "VISA TCP Listener.gtype"
  "error out": error
diagram:
  case ($"error in") {
    frame No Error {
      Tcp Create Listener(error in=$"error in", port=$port, timeout ms=$"timeout ms") -> (error out=w1, listener ID=w3)
      Property Node(instance in=$"VISA TCP listener in", "Listener ID"=w3) -> (instance out=w2)
    }
    frame Error {
      w1 = $"error in"
      w2 = $"VISA TCP listener in"
    }
  }
  $"VISA TCP listener out" <- w2
  $"error out" <- w1
