vi "Wait on Listener.gvi"   [LabVIEW Conversion 4.0.0]
# Listens for an incoming TCP socket connection on the given port.
# WebSockets 2.0.1.40
# Sam Sharp - MediaMongrels Ltd
# Copyright (c) 2019, MediaMongrels Ltd
inputs:
  "VISA TCP listener in": "VISA TCP Listener.gtype"
  "timeout ms": i32 = 5000
  "error in": error
outputs:
  "VISA TCP listener out": "VISA TCP Listener.gtype"
  "socket out": "Socket.gtype"
  "error out": error
uses:
  Sockets::VISA TCP.gtype::New TCP Socket from Refnum.gvi
diagram:
  case ($"error in") {
    frame No Error {
      Property Node(instance in=$"VISA TCP listener in") -> ("Listener ID"=w4)
      Tcp Wait On Listener(error in=$"error in", listener ID in=w4, timeout ms=$"timeout ms") -> (connection ID=w5, error out=w6, listener ID out=w7)
      Property Node(instance in=$"VISA TCP listener in", "Listener ID"=w7) -> (instance out=w3)
      call "New TCP Socket from Refnum.gvi"(TCP network connection refnum=w5, error in=w6) -> (VISA TCP out=w1, error out=w2)
    }
    frame Error {
      w1 = default
      w2 = $"error in"
      w3 = $"VISA TCP listener in"
    }
  }
  $"VISA TCP listener out" <- w3
  $"socket out" <- w1
  $"error out" <- w2
