vi "New TCP Socket Connection.gvi"   [LabVIEW Conversion 4.0.0]
# Opens a new TCP Socket connection on the given hostname/port.
# WebSockets 2.0.1.40
# Sam Sharp - MediaMongrels Ltd
# Copyright (c) 2019, MediaMongrels Ltd
inputs:
  "hostname / IP": string, required
  "port": u16, required
  "timeout ms": i32 = 5000
  "error in": error
outputs:
  "VISA TCP out": "VISA TCP.gtype"
  "error out": error
diagram:
  case ($"error in") {
    frame No Error {
      Tcp Open Connection(address=$"hostname / IP", error in=$"error in", remote port or service name=$port, timeout ms=$"timeout ms") -> (connection ID=w3, error out=w1)
      Property Node(instance in="VISA TCP.gtype" constant, "TCP Refnum"=w3) -> (instance out=w2)
    }
    frame Error {
      w1 = $"error in"
      w2 = "VISA TCP.gtype" constant
    }
  }
  $"VISA TCP out" <- w2
  $"error out" <- w1
