vi "Close.gvi"   [LabVIEW Conversion 4.0.0]
# Closes the socket connection.
# WebSockets 2.0.1.40
# Sam Sharp - MediaMongrels Ltd
# Copyright (c) 2019, MediaMongrels Ltd
inputs:
  "VISA TCP in": "VISA TCP.gtype"
  "error in": error
outputs:
  "error out": error
diagram:
  Property Node(instance in=$"VISA TCP in") -> ("TCP Refnum"=w1)
  Tcp Close Connection(connection ID=w1, error in=$"error in") -> (error out=w2)
  $"error out" <- w2
