vi "Read.gvi"   [LabVIEW NXG 4.0.0]
# Reads data from a socket connection.
# WebSockets 2.0.1.40
# Sam Sharp - MediaMongrels Ltd
# Copyright (c) 2019, MediaMongrels Ltd
inputs:
  "VISA TCP in": "VISA TCP.gtype"
  "# bytes to read": i32, required
  "timeout ms": i32
  "error in": error
outputs:
  "VISA TCP out": "VISA TCP.gtype"
  "read bytes": u8[]
  "error out": error
diagram:
  case ($"error in") {
    frame No Error {
      in-place {
        Unbundle Bundle Read Poser() -> ("TCP Refnum"=w4)
        Tcp Read Binary(bytes to read=$"# bytes to read", connection ID=w4, error in=$"error in", timeout ms=$"timeout ms") -> (connection ID out=w5, data out=w3, error out=w2)
        Unbundle Bundle Write Poser("TCP Refnum"=w5)
      }
    }
    frame Error {
      w1 = $"VISA TCP in"
      w2 = $"error in"
      w3 = default
    }
  }
  $"VISA TCP out" <- w1
  $"read bytes" <- w3
  $"error out" <- w2
