vi "Write.gvi"   [LabVIEW NXG 4.0.0]
# Writes data to the socket.
# WebSockets 2.0.1.40
# Sam Sharp - MediaMongrels Ltd
# Copyright (c) 2019, MediaMongrels Ltd
inputs:
  "VISA TCP in": "VISA TCP.gtype"
  "bytes to write": u8[], required
  "timeout ms": i32
  "error in": error
outputs:
  "VISA TCP out": "VISA TCP.gtype"
  "bytes written": i32
  "error out": error
diagram:
  case ($"error in") {
    frame No Error {
      in-place {
        Unbundle Bundle Read Poser() -> ("TCP Refnum"=w4)
        Tcp Write Binary(connection ID=w4, data in=$"bytes to write", error in=$"error in", timeout ms=$"timeout ms") -> (bytes written=w3, connection ID out=w5, error out=w2)
        Unbundle Bundle Write Poser("TCP Refnum"=w5)
      }
    }
    frame Error {
      w1 = $"VISA TCP in"
      w2 = $"error in"
      w3 = default
    }
  }
  $"VISA TCP out" <- w1
  $"bytes written" <- w3
  $"error out" <- w2
