vi "New Client.gvi"   [LabVIEW NXG 4.0.0]
# Opens a conenction and creates a new WebSocket Client using the NI VISA TCP Socket.
# WebSockets 2.0.1.40
# Sam Sharp - MediaMongrels Ltd
# Copyright (c) 2019, MediaMongrels Ltd
inputs:
  "webSocket URL": string, required
  "timeout ms": i32 = 5000
  "error in": error
outputs:
  "webSocket client out": "WebSocket Client.gtype"
  "error out": error
uses:
  WebSockets::WebSocket Client.gtype::Parse URL.gvi
  Sockets::VISA TCP.gtype::New TCP Socket Connection.gvi
diagram:
  case ($"error in") {
    frame No Error {
      call "Parse URL.gvi"(webSocket URL=$"webSocket URL", error in=$"error in") -> (port=w3, host=w4, error out=w5)
      call "New TCP Socket Connection.gvi"(hostname / IP=w4, port=w3, timeout ms=$"timeout ms", error in=w5) -> (VISA TCP out=w6, error out=w7)
      Property Node(instance in="WebSocket Client.gtype" constant, "Socket"=w6, "URL"=$"webSocket URL", error in=w7) -> (error out=w2, instance out=w1)
    }
    frame Error {
      w1 = "WebSocket Client.gtype" constant
      w2 = $"error in"
    }
  }
  $"webSocket client out" <- w1
  $"error out" <- w2
