vi "Add Client Protocol Header.gvi"   [LabVIEW NXG 4.0.0]
# If supported protocols have been specified, adds the Sec-WebSocket-Protocol header to the send headers.
# WebSockets 2.0.1.40
# Sam Sharp - MediaMongrels Ltd
# Copyright (c) 2019, MediaMongrels Ltd
inputs:
  "webSocket client in": "WebSocket Client.gtype", required
  "error in": error
outputs:
  "webSocket client out": "WebSocket Client.gtype"
  "error out": error
uses:
  WebSocketsDependencies::Join Strings.gvi
  WebSockets::WebSocket.gtype::Set Send Header.gvi
diagram:
  case ($"error in") {
    frame No Error {
      Property Node(instance in=$"webSocket client in", error in=$"error in") -> ("Protocols"=w3, error out=w4, instance out=w5)
      Is Empty Array(array=w3) -> w6
      case (w6) {
        frame False, Default {
          call "Join Strings.gvi"(strings in=w3, separator=", ") -> (string=w7)
          call "Set Send Header.gvi"(webSockets in=w5, name="Sec-WebSocket-Protocol", value=w7, error in=w4) -> (webSockets out=w2, error out=w1)
        }
        frame True {
          w2 = w5
          w1 = w4
        }
      }
    }
    frame Error {
      w1 = $"error in"
      w2 = $"webSocket client in"
    }
  }
  $"webSocket client out" <- w2
  $"error out" <- w1
