vi "GenerateWebSocketClientKey.gvi"   [LabVIEW NXG 4.0.0]
# Generates a random string of 16 ASCII characters (from ASCII 37 to 127) for the Sec-WebSocket-Key.
# WebSockets 2.0.1.40
# Sam Sharp - MediaMongrels Ltd
# Copyright (c) 2019, MediaMongrels Ltd
outputs:
  "webSocket key": string
uses:
  NI::G Core::Numeric::Random Number (Range) U64.gvi
  WebSockets::WebSocket.gtype::Util Convert to Base64.gvi
diagram:
  # The request MUST include a header field with the name
  #         |Sec-WebSocket-Key|.  The value of this header field MUST be a
  #         nonce consisting of a randomly selected 16-byte value that has
  #         been base64-encoded (see Section 4 of [RFC4648]).  The nonce
  #         MUST be selected randomly for each connection.
  #
  #         NOTE: As an example, if the randomly selected value was the
  #         sequence of bytes 0x01 0x02 0x03 0x04 0x05 0x06 0x07 0x08 0x09
  #         0x0a 0x0b 0x0c 0x0d 0x0e 0x0f 0x10, the value of the header
  #         field would be "AQIDBAUGBwgJCgsMDQ4PEC=="
  for (N = 16) {
    call "Random Number (Range) U64.gvi"(upper bound=127, lower bound=37) -> (number=w2)
    To Unsigned 8 Bit Integer(number=w2) -> w3
    append w3 to w1
  }
  Byte Array To String(encoding="Extended ASCII", unsigned byte array=w1) -> (string=w4)
  call "Util Convert to Base64.gvi"(string=w4) -> (base64 string=w5)
  $"webSocket key" <- w5
