vi "Handshake.gvi"   [LabVIEW NXG 4.0.0]
# Performs a client-side handshake. Sends the initial handshake HTTP header and waits for response from WebSocket server. Validates received accept key from the response.
# WebSockets 2.0.1.40
# Sam Sharp - MediaMongrels Ltd
# Copyright (c) 2019, MediaMongrels Ltd
inputs:
  "webSocket client in": "WebSocket Client.gtype"
  "timeout ms": i32 = 5000
  "error in": error
outputs:
  "webSocket client out": "WebSocket Client.gtype"
  "error out": error
uses:
  WebSockets::WebSocket Client.gtype::Add Client Protocol Header.gvi
  WebSockets::WebSocket Client.gtype::Parse URL.gvi
  WebSockets::WebSocket Client.gtype::GenerateWebSocketClientKey.gvi
  WebSockets::WebSocket.gtype::Socket Write.gvi
  WebSockets::WebSocket.gtype::ReadHTTPHeader.gvi
  WebSockets::WebSocket.gtype::ProcessHandshakeRequest.gvi
  WebSockets::WebSocket.gtype::Validate Supported Protocols.gvi
  WebSockets::WebSocket.gtype::Read Return Header.gvi
  WebSockets::WebSocket.gtype::ProduceAcceptKey.gvi
  NI::G Core::Error::Legacy::Error Cluster From Error Code.gvi
diagram:
  case ($"error in") {
    frame No Error {
      call "Add Client Protocol Header.gvi"(webSocket client in=$"webSocket client in", error in=$"error in") -> (webSocket client out=w3, error out=w4)
      Property Node(instance in=w3, error in=w4) -> ("Send Header String"=w5, "URL"=w6, error out=w7, instance out=w8)
      call "Parse URL.gvi"(webSocket URL=w6, error in=w7) -> (host=w9, URI=w10, error out=w11)
      w12 = "GET %s HTTP/1.1\nHost: %s\nConnection: Upgrade\nUpgrade: websocket\nSec-WebSocket-Version: 13\nSec-WebSocket-Key: %s%s\n\n"
      call "GenerateWebSocketClientKey.gvi"() -> (webSocket key=w13)
      Format Into String(formatString=w12, w10, w9, w13, w5) -> w14
      Search And Replace String(input string=w14, replace all (F)=TRUE, replace string ("")="\r\n", search string="\n") -> (result string=w15)
      String To Byte Array(encoding="Extended ASCII", string=w15) -> (unsigned byte array=w16)
      call "Socket Write.gvi"(webSocket in=w8, bytes to write=w16, timeout ms=$"timeout ms", error in=w11) -> (webSocket out=w17, error out=w18)
      call "ReadHTTPHeader.gvi"(webSocket in=w17, timeout ms=$"timeout ms", error in=w18) -> (webSocket out=w19, HTTP header=w20, error out=w21)
      call "ProcessHandshakeRequest.gvi"(webSocket in=w19, HTTP header=w20, error in=w21) -> (webSocket out=w22, error out=w23)
      call "Validate Supported Protocols.gvi"(webSocket in=w22, error in=w23) -> (webSocket out=w24, error out=w25)
      call "Read Return Header.gvi"(webSocket in=w24, name="Sec-WebSocket-Accept", error in=w25) -> (webSocket out=w1, value=w26, error out=w27)
      call "ProduceAcceptKey.gvi"(sec-webSocket-key=w13) -> (sec-webSocket-accept=w28)
      Is Equal(x=w26, y=w28) -> w29
      case (w29) {
        frame False, Default {
          call "Error Cluster From Error Code.gvi"(error code=52, error message="Invalid handshake received.", error in=w27) -> (error out=w2)
        }
        frame True {
          w2 = w27
        }
      }
    }
    frame Error {
      w1 = $"webSocket client in"
      w2 = $"error in"
    }
  }
  $"webSocket client out" <- w1
  $"error out" <- w2
