vi "Parse URL.gvi"   [LabVIEW Conversion 4.0.0]
# Parses the WebSockets URL to protocol (e.g. ws://), hostname, port and URI.
# Port defaults to 80 for ws:// and http:// and 443 for wss:// and https://
# WebSockets 2.0.1.40
# Sam Sharp - MediaMongrels Ltd
# Copyright (c) 2019, MediaMongrels Ltd
inputs:
  "webSocket URL": string, required
  "error in": error
outputs:
  "port": u16
  "protocol": string
  "host": string
  "URI": string
  "error out": error
uses:
  NI::G Core::Error::Legacy::Error Cluster From Error Code.gvi
diagram:
  Search Or Split String(search string/char="://", string=$"webSocket URL") -> (match + rest of string=w1, substring before match=w2)
  $protocol <- w2
  String Subset(offset (0)=3, string=w1) -> w3
  Search Or Split String(search string/char="/", string=w3) -> (match + rest of string=w4, substring before match=w5)
  Search Or Split String(search string/char=":", string=w5) -> (match + rest of string=w6, substring before match=w7)
  $host <- w7
  # ws://host/path
  # ws://host:port/path
  # ws://host
  # ws://host:port
  # wss://
  case (w2) {
    frame Default {
      w8 = 0
    }
    frame "http", "ws" {
      w8 = 80
    }
    frame "https", "wss" {
      w8 = 443
    }
  }
  String Subset(offset (0)=1, string=w6) -> w9
  Decimal String To Number(default (0 I32)=0, string=w9) -> (number=w10)
  Is Equal To 0(x=w10) -> w11
  Select(s=w11, t=w8, f=w10) -> w12
  $port <- w12
  Is Empty String Or Path(string/path=w4) -> w13
  Select(s=w13, t="/", f=w4) -> w14
  $URI <- w14
  Is Empty String Or Path(string/path=w2) -> w15
  Is Empty String Or Path(string/path=w5) -> w16
  Logical Or(w15, w16) -> w17
  case (w17) {
    frame False, Default {
      w18 = $"error in"
    }
    frame True {
      Format Into String(formatString="Invalid url (%s)", errIn=$"error in", $"webSocket URL") -> (outString=w19, errOut=w20)
      call "Error Cluster From Error Code.gvi"(error code=1, error message=w19, error in=w20) -> (error out=w18)
    }
  }
  $"error out" <- w18
