vi "Handshake.gvi"   [LabVIEW NXG 4.0.0]
# Performs the Server Handshake - reads incoming HTTP WebSocket header from the client and sends the HTTP server response.
# WebSockets 2.0.1.40
# Sam Sharp - MediaMongrels Ltd
# Copyright (c) 2019, MediaMongrels Ltd
inputs:
  "webSocket connection in": "WebSocket Server.gtype"
  "timeout ms": i32 = 5000
  "error in": error
outputs:
  "webSocket connection out": "WebSocket Server.gtype"
  "error out": error
panel indicators:
  "HTTP headers": string
uses:
  WebSockets::WebSocket.gtype::ReadHTTPHeader.gvi
  WebSockets::WebSocket.gtype::ProcessHandshakeRequest.gvi
  NI::G Core::Error::Legacy::Error Cluster From Error Code.gvi
  WebSockets::WebSocket.gtype::Validate Supported Protocols.gvi
  WebSockets::WebSocket.gtype::HandshakeResponse.gvi
  WebSockets::WebSocket.gtype::Socket Write.gvi
diagram:
  case ($"error in") {
    frame No Error {
      call "ReadHTTPHeader.gvi"(webSocket in=$"webSocket connection in", timeout ms=$"timeout ms", error in=$"error in") -> (webSocket out=w3, HTTP header=w4, error out=w5)
      # (for debug)
      $"HTTP headers" <- w4
      call "ProcessHandshakeRequest.gvi"(webSocket in=w3, HTTP header=w4, error in=w5) -> (webSocket out=w6, is websocket request?=w7, sec-webSocket-key=w8, error out=w9)
      case (w7) {  # Send Response
        frame False, Default {
          call "Error Cluster From Error Code.gvi"(error code=52, error message="Invalid handshake data received.", error in=w9, show call chain?=TRUE) -> (error out=w2)
          w1 = w6
        }
        frame True {
          call "Validate Supported Protocols.gvi"(webSocket in=w6, error in=w9) -> (webSocket out=w10, error out=w11)
          call "HandshakeResponse.gvi"(webSocket in=w10, sec-webSocket-key=w8, error in=w11) -> (webSocket out=w12, response headers=w13, error out=w14)
          String To Byte Array(encoding="UTF-8", string=w13) -> (unsigned byte array=w15)
          call "Socket Write.gvi"(webSocket in=w12, bytes to write=w15, timeout ms=$"timeout ms", error in=w14) -> (webSocket out=w1, error out=w2)
        }
      }
    }
    frame Error {
      w1 = $"webSocket connection in"
      w2 = $"error in"
    }
  }
  $"webSocket connection out" <- w1
  $"error out" <- w2
