vi "Parse HTTP Header Line.gvi"   [LabVIEW Conversion 4.0.0]
# Parses the first row of the HTTP request to determine the method/URI/protocol.
# WebSockets 2.0.1.40
# Sam Sharp - MediaMongrels Ltd
# Copyright (c) 2019, MediaMongrels Ltd
inputs:
  "webSocket server in": "WebSocket Server.gtype"
  "HTTP header line": string, required
  "error in": error
outputs:
  "webSocket server out": "WebSocket Server.gtype"
  "error out": error
panel indicators:
  "request URI": string
  "method": string
  "protocol": string
diagram:
  case ($"error in") {
    frame No Error {
      Spreadsheet String To Array(array type=string[] [], delimiter=" ", format string="%s", spreadsheet string=$"HTTP header line") -> (array=w6)
      Array Index(array=w6) -> (out0[_]=w2, out1[_]=w1, out2[_]=w3)
      Property Node(instance in=$"webSocket server in", "Request URI"=w1) -> (instance out=w5)
      w4 = $"error in"
    }
    frame Error {
      w1 = default
      w2 = default
      w3 = default
      w4 = $"error in"
      w5 = $"webSocket server in"
    }
  }
  $method <- w2
  $"request URI" <- w1
  $protocol <- w3
  $"webSocket server out" <- w5
  $"error out" <- w4
