vi "Close.gvi"   [LabVIEW NXG 4.0.0]
# Sends the close frame to the WebSocket endpoint and closes the socket connection.
# WebSockets 2.0.1.40
# Sam Sharp - MediaMongrels Ltd
# Copyright (c) 2019, MediaMongrels Ltd
inputs:
  "webSocket in": "WebSocket.gtype"
  "timeout ms": i32 = 5000
  "error in": error
outputs:
  "error out": error
uses:
  WebSockets::WebSocket.gtype::Close Frame.gvi
  Sockets::Socket.gtype::Close.gvi
diagram:
  call "Close Frame.gvi"(webSockets in=$"webSocket in", timeout ms=$"timeout ms", error in=$"error in") -> (webSockets out=w1, error out=w2)
  Property Node(instance in=w1, error in=w2) -> ("Socket"=w3, error out=w4)
  call "Close.gvi"(socket in=w3, error in=w4) -> (error out=w5)
  $"error out" <- w5
