vi "Ping.gvi"   [LabVIEW NXG 4.0.0]
# Sends a Ping frame to the connection endpoint. A pong response with the same payload should be received. Can be used as a keep-alive and for determining connection status.
# WebSockets 2.0.1.40
# Sam Sharp - MediaMongrels Ltd
# Copyright (c) 2019, MediaMongrels Ltd
inputs:
  "webSocket in": "WebSocket.gtype"
  "payload": u8[], required
  "timeout ms": i32 = 5000, required
  "error in": error
outputs:
  "webSocket out": "WebSocket.gtype"
  "error out": error
uses:
  WebSockets::WebSocket.gtype::Low-Level Write.gvi
diagram:
  Property Node(instance in=$"webSocket in", error in=$"error in") -> ("Is Server"=w1, error out=w2, instance out=w3)
  Not(x=w1) -> w4
  call "Low-Level Write.gvi"(mask payload?=w4, webSockets in=w3, data=$payload, timeout ms=$"timeout ms", error in=w2, opcode="Ping"(9), finished?=TRUE) -> (webSockets out=w5, error out=w6)
  $"webSocket out" <- w5
  $"error out" <- w6
