vi "Pong.gvi"   [LabVIEW NXG 4.0.0]
# Sends a Pong frame to the connection endpoint, the payload should contain the payload from the received Ping request.
# WebSockets 2.0.1.40
# Sam Sharp - MediaMongrels Ltd
# Copyright (c) 2019, MediaMongrels Ltd
inputs:
  "webSocket in": "WebSocket.gtype"
  "ping payload": u8[], required
  "timeout ms": i32 = 5000, required
  "error in": error
outputs:
  "webSocket out": "WebSocket.gtype"
  "error out": error
uses:
  WebSockets::WebSocket.gtype::Low-Level Write.gvi
diagram:
  Property Node(instance in=$"webSocket in", error in=$"error in") -> ("Is Server"=w1, error out=w2, instance out=w3)
  Not(x=w1) -> w4
  call "Low-Level Write.gvi"(mask payload?=w4, webSockets in=w3, data=$"ping payload", timeout ms=$"timeout ms", error in=w2, opcode="Pong"(10), finished?=TRUE) -> (webSockets out=w5, error out=w6)
  $"webSocket out" <- w5
  $"error out" <- w6
