vi "Read Return Header.gvi"   [LabVIEW NXG 4.0.0]
# Retrieves a named header from the received HTTP handshaking data.
# WebSockets 2.0.1.40
# Sam Sharp - MediaMongrels Ltd
# Copyright (c) 2019, MediaMongrels Ltd
inputs:
  "webSocket in": "WebSocket.gtype", required
  "name": string, required
  "error in": error
outputs:
  "webSocket out": "WebSocket.gtype"
  "value": string
  "found?": bool
  "error out": error
diagram:
  case ($"error in") {
    frame No Error {
      in-place {
        Unbundle Bundle Read Poser() -> ("Return Headers"=w5)
        Get Variant Attribute(default value="", error in=$"error in", name=$name, variant=w5) -> (error out=w3, found?=w4, value=w1, variant out=w6)
        Unbundle Bundle Write Poser("Return Headers"=w6)
      }
    }
    frame Error {
      w1 = ""
      w2 = $"webSocket in"
      w3 = $"error in"
      w4 = FALSE
    }
  }
  $"webSocket out" <- w2
  $"found?" <- w4
  $value <- w1
  $"error out" <- w3
