vi "Read Send Header String.gvi"   [LabVIEW Conversion 4.0.0]
# Generates HTTP header string from the send headers.
# WebSockets 2.0.1.40
# Sam Sharp - MediaMongrels Ltd
# Copyright (c) 2019, MediaMongrels Ltd
inputs:
  "webSocket in": "WebSocket.gtype"
  "error in": error
outputs:
  "webSocket out": "WebSocket.gtype"
  "send header string": string
  "error out": error
diagram:
  case ($"error in") {
    frame No Error {
      Property Node(instance in=$"webSocket in") -> ("Send Headers"=w4)
      Get Variant Attribute[GetAllAttributes=True](error in=$"error in", variant=w4) -> (error out=w5, names=w6, values=w7)
      s1 = w5  # shift register
      for {
        w8 = each element of w6
        w9 = each element of w7
        Variant To Data(error in (no error)=s1, type=string "", variant=w9) -> (data=w11, error out=w12)
        Format Into String(formatString="\n%s: %s", errIn=w12, w8, w11) -> (outString=w13, errOut=w14)
        append w13 to w10
        next s1 = w14
      }
      Concatenate Strings(w10) -> w3
      w1 = s1
      w2 = $"webSocket in"
    }
    frame Error {
      w1 = $"error in"
      w2 = $"webSocket in"
      w3 = default
    }
  }
  $"webSocket out" <- w2
  $"send header string" <- w3
  $"error out" <- w1
