vi "Write Send Headers.gvi"   [LabVIEW NXG 4.0.0]
# Adds HTTP headers to include in the WebSocket handshake HTTP request.
# WebSockets 2.0.1.40
# Sam Sharp - MediaMongrels Ltd
# Copyright (c) 2019, MediaMongrels Ltd
inputs:
  "webSockets in": "WebSocket.gtype", required
  "additional send headers": "Headers.gtype"[], required
  "error in": error
outputs:
  "webSockets out": "WebSocket.gtype"
  "error out": error
types:
  "Headers.gtype" = cluster{"Name": string, "Value": string}
uses:
  WebSockets::WebSocket.gtype::Set Send Header.gvi
diagram:
  case ($"error in") {
    frame No Error {
      s1 = $"webSockets in"  # shift register
      s2 = $"error in"  # shift register
      for {
        w3 = each element of $"additional send headers"
        Property Node(instance in=w3) -> ("Name"=w4, "Value"=w5)
        call "Set Send Header.gvi"(webSockets in=s1, name=w4, value=w5, error in=s2) -> (webSockets out=w6, error out=w7)
        next s1 = w6
        next s2 = w7
      }
      w1 = s2
      w2 = s1
    }
    frame Error {
      w1 = $"error in"
      w2 = $"webSockets in"
    }
  }
  $"webSockets out" <- w2
  $"error out" <- w1
