vi "Read Binary.gvi"   [LabVIEW Conversion 4.0.0]
# Reads a binary frame from a WebSocket connection endpoint. Internally handles fragmented messages and Ping requests.
# If a text frame is received, the data will be returned and a warning generated.
# WebSockets 2.0.1.40
# Sam Sharp - MediaMongrels Ltd
# Copyright (c) 2019, MediaMongrels Ltd
inputs:
  "webSocket in": "WebSocket.gtype"
  "timeout ms": i32 = 5000
  "error in": error
outputs:
  "webSocket out": "WebSocket.gtype"
  "data": u8[]
  "error out": error
uses:
  WebSockets::WebSocket.gtype::Internal Read.gvi
  NI::G Core::Error::Legacy::Error Cluster From Error Code.gvi
diagram:
  case ($"error in") {
    frame No Error {
      call "Internal Read.gvi"(webSocket in=$"webSocket in", timeout ms=$"timeout ms", error in=$"error in") -> (webSocket out=w2, data=w3, opcode=w4, error out=w5)
      case (w4) {
        frame Default {
          w1 = w5
        }
        frame 1 {
          call "Error Cluster From Error Code.gvi"(error code=9131, error message="Text frame received.", error in=w5, is warning?=TRUE) -> (error out=w1)
        }
      }
    }
    frame Error {
      w1 = $"error in"
      w2 = $"webSocket in"
      w3 = default
    }
  }
  $data <- w3
  $"webSocket out" <- w2
  $"error out" <- w1
