vi "Read Text.gvi"   [LabVIEW NXG 4.0.0]
# Reads a text frame from a WebSocket connection endpoint. Internally handles fragmented messages and Ping requests.
# If a binary frame is received, the data will be returned and a warning generated.
# WebSockets 2.0.1.40
# Sam Sharp - MediaMongrels Ltd
# Copyright (c) 2019, MediaMongrels Ltd
inputs:
  "webSocket in": "WebSocket.gtype"
  "timeout ms": i32 = 5000
  "error in": error
outputs:
  "webSocket out": "WebSocket.gtype"
  "data": string
  "error out": error
uses:
  WebSockets::WebSocket.gtype::Internal Read.gvi
  NI::G Core::Error::Legacy::Error Cluster From Error Code.gvi
diagram:
  case ($"error in") {
    frame No Error {
      call "Internal Read.gvi"(webSocket in=$"webSocket in", timeout ms=$"timeout ms", error in=$"error in") -> (webSocket out=w2, data=w4, opcode=w5, error out=w6)
      Byte Array To String(encoding="UTF-8", unsigned byte array=w4) -> (string=w3)
      case (w5) {
        frame Default {
          w1 = w6
        }
        frame 2 {
          call "Error Cluster From Error Code.gvi"(error code=9130, error message="Binary frame received.", error in=w6, is warning?=TRUE) -> (error out=w1)
        }
      }
    }
    frame Error {
      w1 = $"error in"
      w2 = $"webSocket in"
      w3 = default
    }
  }
  $data <- w3
  $"webSocket out" <- w2
  $"error out" <- w1
