vi "Set Return Header.gvi"   [LabVIEW NXG 4.0.0]
# Adds a single return header to the WebSocket object. Used internally to process the response headers.
# WebSockets 2.0.1.40
# Sam Sharp - MediaMongrels Ltd
# Copyright (c) 2019, MediaMongrels Ltd
inputs:
  "webSockets in": "WebSocket.gtype", required
  "name": string, required
  "value": string, required
  "error in": error
outputs:
  "webSockets out": "WebSocket.gtype"
  "error out": error
diagram:
  case ($"error in") {
    frame No Error {
      in-place {
        Unbundle Bundle Read Poser() -> ("Return Headers"=w3)
        Set Variant Attribute(error in=$"error in", name=$name, value=$value, variant=w3) -> (error out=w1, variant out=w4)
        Unbundle Bundle Write Poser("Return Headers"=w4)
      }
    }
    frame Error {
      w1 = $"error in"
      w2 = $"webSockets in"
    }
  }
  $"webSockets out" <- w2
  $"error out" <- w1
