vi "Calculate Timeout.gvi"   [LabVIEW Conversion 4.0.0]
# Calculates the remaining timeout since t0. Used to ensure calling VI doesn't exceed maximum timeout.
# WebSockets 2.0.1.40
# Sam Sharp - MediaMongrels Ltd
# Copyright (c) 2019, MediaMongrels Ltd
inputs:
  "t0": u32, required
  "timeout ms": i32, required
  "error in": error
outputs:
  "elapsed?": bool
  "error out": error
  "new timeout ms": i32
uses:
  WebSockets::WebSocket.gtype::Tick Count with Error Wires.gvi
diagram:
  call "Tick Count with Error Wires.gvi"(error in=$"error in") -> (error out=w1, millisecond timer value=w2)
  $"error out" <- w1
  Subtract(x=w2, y=$t0) -> w3: f64 Saturate:ConvergentRounding
  To Signed 32 Bit Integer(number=w3) -> w4
  Subtract(x=$"timeout ms", y=w4) -> w5
  In Range And Coerce[IncludeHighLimit=True](lower limit=0, upper limit=$"timeout ms", x=w5) -> (coerced(x)=w6)
  $"new timeout ms" <- w6
  Is Greater Or Equal(x=w4, y=$"timeout ms") -> w7
  $"elapsed?" <- w7
