vi "Close Frame.gvi"   [LabVIEW NXG 4.0.0]
# Sends a WebSocket close frame to the connection endpoint but does not close the underlying socket connection.
# WebSockets 2.0.1.40
# Sam Sharp - MediaMongrels Ltd
# Copyright (c) 2019, MediaMongrels Ltd
inputs:
  "webSockets in": "WebSocket.gtype"
  "timeout ms": i32 = 5000
  "error in": error
outputs:
  "webSockets out": "WebSocket.gtype"
  "error out": error
uses:
  WebSockets::WebSocket.gtype::Low-Level Write.gvi
diagram:
  Property Node(instance in=$"webSockets in", error in=$"error in") -> ("Is Server"=w1, error out=w2, instance out=w3)
  Not(x=w1) -> w4
  call "Low-Level Write.gvi"(mask payload?=w4, webSockets in=w3, data=u8[] [], timeout ms=$"timeout ms", opcode="Close Frame"(8)) -> (webSockets out=w5, error out=w6)
  $"webSockets out" <- w5
  Merge Errors(w2, w6) -> (error out=w7)
  $"error out" <- w7
