vi "DataLengthBytes.gvi"   [LabVIEW Conversion 4.0.0]
# Generates the message length bytes of the WebSockets packet. A varying number of bytes is used to indicate the length of the data.
# WebSockets 2.0.1.40
# Sam Sharp - MediaMongrels Ltd
# Copyright (c) 2019, MediaMongrels Ltd
inputs:
  "data": u8[], required
  "is masked?": bool = TRUE
outputs:
  "length bytes": u8[]
diagram:
  Select(s=$"is masked?", t=128, f=0) -> w1
  Array Size(array=$data) -> (size(s)=w2)
  Select(s=$"is masked?", t=4, f=0) -> w3
  Subtract(x=w2, y=w3) -> w4
  case (w4) {
    frame 0..125 {
      To Unsigned 8 Bit Integer(number=w4) -> w6
      Logical Or(w6, w1) -> w7
      Build Array(w7) -> w5
    }
    frame 126..65535 {
      Logical Or(0x7E, w1) -> w8
      To Unsigned 16 Bit Integer(number=w4) -> w9
      Split Number(x=w9) -> (high(x)=w10, low(x)=w11)
      Build Array(w8, w10, w11) -> w5
    }
    frame Default {
      Logical Or(0x7F, w1) -> w12
      Split Number(x=w4) -> (high(x)=w13, low(x)=w14)
      Split Number(x=w13) -> (high(x)=w15, low(x)=w16)
      Split Number(x=w14) -> (high(x)=w17, low(x)=w18)
      Build Array(w12, 0x0, 0x0, 0x0, 0x0, w15, w16, w17, w18) -> w5
    }
  }
  $"length bytes" <- w5
