vi "DecodeMaskedBytes.gvi"   [LabVIEW NXG 4.0.0]
# Unmasks incoming data. Data sent to the client does not need to be masked.
# WebSockets 2.0.1.40
# Sam Sharp - MediaMongrels Ltd
# Copyright (c) 2019, MediaMongrels Ltd
inputs:
  "encoded data": u8[], required
  "mask bytes": u8[], required
  "error in": error
outputs:
  "decoded data": u8[]
  "error out": error
diagram:
  # for i = indexFirstDataByte, j = 0; i < bytes.length; i++, j++
  #     decoded[j] = bytes[i] XOR masks[j MOD 4]
  case ($"error in") {
    frame No Error {
      # 4-Byte Mask
      for (iteration -> i1) {
        w3 = each element of $"encoded data"
        Quotient And Remainder(x=i1, y=4) -> (x-y*floor(x/y)=w4)
        Array Index(array=$"mask bytes") -> (out0[w4]=w5)
        Logical Exclusive Or(w5, w3) -> w6
        append w6 to w1
      }
      w2 = $"error in"
    }
    frame Error {
      w1 = default
      w2 = $"error in"
    }
  }
  $"error out" <- w2
  $"decoded data" <- w1
