vi "EncodeMaskedBytes.gvi"   [LabVIEW Conversion 4.0.0]
# Unmasks incoming data. Data sent to the client does not need to be masked.
# WebSockets 2.0.1.40
# Sam Sharp - MediaMongrels Ltd
# Copyright (c) 2019, MediaMongrels Ltd
inputs:
  "raw data": u8[], required
  "error in": error
outputs:
  "masked data": u8[]
  "error out": error
diagram:
  # for i = indexFirstDataByte, j = 0; i < bytes.length; i++, j++
  #     decoded[j] = bytes[i] XOR masks[j MOD 4]
  case ($"error in") {
    frame No Error {
      # 4-Byte Mask
      for (N = 4) {
        Random Number() -> (number (0 to 1)=w4)
        Multiply(w4, 256) -> w5
        To Unsigned 8 Bit Integer(number=w5) -> w6
        append w6 to w3
      }
      for (iteration -> i1) {
        w7 = each element of $"raw data"
        Quotient And Remainder(x=i1, y=4) -> (x-y*floor(x/y)=w9)
        Array Index(array=w3) -> (out0[w9]=w10)
        Logical Exclusive Or(w10, w7) -> w11
        append w11 to w8
      }
      Build Array(w3, w8) -> w1
      w2 = $"error in"
    }
    frame Error {
      w1 = default
      w2 = $"error in"
    }
  }
  $"error out" <- w2
  $"masked data" <- w1
