vi "HandshakeResponse.gvi"   [LabVIEW Conversion 4.0.0]
# Creates the HTTP handshaking response.
# WebSockets 2.0.1.40
# Sam Sharp - MediaMongrels Ltd
# Copyright (c) 2019, MediaMongrels Ltd
inputs:
  "webSocket in": "WebSocket.gtype", required
  "sec-webSocket-key": string, required
  "error in": error
outputs:
  "webSocket out": "WebSocket.gtype"
  "response headers": string
  "error out": error
uses:
  WebSockets::WebSocket.gtype::ProduceAcceptKey.gvi
diagram:
  case ($"error in") {
    frame No Error {
      Property Node(instance in=$"webSocket in", error in=$"error in") -> ("Send Header String"=w4, error out=w5, instance out=w3)
      w6 = "HTTP/1.1 101 Switching Protocols\nUpgrade: websocket\nConnection: Upgrade\nSec-WebSocket-Accept: %s%s\n\n"
      call "ProduceAcceptKey.gvi"(sec-webSocket-key=$"sec-webSocket-key") -> (sec-webSocket-accept=w7)
      # Replace with HTTP \r\n
      Format Into String(formatString=w6, errIn=w5, w7, w4) -> (outString=w8, errOut=w2)
      Search And Replace String(input string=w8, replace all (F)=TRUE, replace string ("")="\r\n", search string="\n") -> (result string=w1)
    }
    frame Error {
      w1 = default
      w2 = $"error in"
      w3 = $"webSocket in"
    }
  }
  $"webSocket out" <- w3
  $"response headers" <- w1
  $"error out" <- w2
