vi "Internal Read.gvi"   [LabVIEW NXG 4.0.0]
# Performs a read operation and handles internal WebSockets considerations.
# - Will read multi-framed messages as a single read
# - Automatically responds to Ping requests
# - Generates an error on receipt of a close frame
# VI will return when a 'complete' frame is read or a timeout occurs.
# WebSockets 2.0.1.40
# Sam Sharp - MediaMongrels Ltd
# Copyright (c) 2019, MediaMongrels Ltd
inputs:
  "webSocket in": "WebSocket.gtype", required
  "timeout ms": i32, required
  "error in": error
outputs:
  "webSocket out": "WebSocket.gtype"
  "data": u8[]
  "opcode": "Opcodes.gtype"
  "error out": error
types:
  "Opcodes.gtype" = u8
uses:
  WebSockets::WebSocket.gtype::Tick Count with Error Wires.gvi
  WebSockets::WebSocket.gtype::Calculate Timeout.gvi
  WebSockets::WebSocket.gtype::Low-Level Read.gvi
  NI::G Core::Error::Legacy::Error Cluster From Error Code.gvi
  WebSockets::WebSocket.gtype::Pong.gvi
diagram:
  call "Tick Count with Error Wires.gvi"(error in=$"error in") -> (error out=w1, millisecond timer value=w2)
  s1 = $"webSocket in"  # shift register
  s2 = "Cont. Frame"(0)  # shift register
  while {
    call "Calculate Timeout.gvi"(t0=w2, timeout ms=$"timeout ms", error in=w1) -> (error out=w4, new timeout ms=w5)
    call "Low-Level Read.gvi"(webSockets in=s1, timeout ms=w5, error in=w4) -> (finished?=w6, webSockets out=w7, data=w8, opcode=w9, error out=w10)
    case (w9) {
      frame Default {
        Format Into String(formatString="Opcode '%d' not supported.", errIn=w10, w9) -> (outString=w16, errOut=w17)
        call "Error Cluster From Error Code.gvi"(error code=1109, error message=w16, error in=w17) -> (error out=w11)
        w12 = w7
        w13 = default
        w14 = TRUE
        w15 = w9
      }
      frame 8 {
        w11 = w10
        w12 = w7
        w13 = default
        w14 = TRUE
        w15 = w9
      }
      frame 0..2 {
        Is Equal To 0(x=w9) -> w18
        # return initial opcode
        Select(s=w18, t=s2, f=w9) -> w15
        w11 = w10
        w12 = w7
        w13 = w8
        w14 = w6
      }
      frame 9 {
        call "Calculate Timeout.gvi"(t0=w2, timeout ms=$"timeout ms", error in=w10) -> (error out=w19, new timeout ms=w20)
        call "Pong.gvi"(webSocket in=w7, ping payload=w8, timeout ms=w20, error in=w19) -> (webSocket out=w12, error out=w11)
        w13 = default
        w14 = FALSE
        w15 = w9
      }
      frame 10 {
        w11 = w10
        w12 = w7
        w13 = default
        w14 = FALSE
        w15 = w9
      }
    }
    Logical Or(w11, w14) -> w21
    concatenate w13 onto w3
    next s1 = w12
    next s2 = w15
    stop if w21
  }
  $opcode <- s2
  $"webSocket out" <- s1
  $data <- w3
  $"error out" <- w11
