vi "Low-Level Read.gvi"   [LabVIEW NXG 4.0.0]
# Reads and decodes an incoming WebSockets frame.
# Opcode: Opcode for the message.
# Data: Contains the WebSockets payload
# Finished?: Determines whether the message is complete for fragmented messages. If false, must continue to read messages (continuation frames with opcode = 0) until Finished? is true.
# WebSockets 2.0.1.40
# Sam Sharp - MediaMongrels Ltd
# Copyright (c) 2019, MediaMongrels Ltd
inputs:
  "webSockets in": "WebSocket.gtype", required
  "timeout ms": i32 = 5000
  "error in": error
outputs:
  "finished?": bool
  "webSockets out": "WebSocket.gtype"
  "data": u8[]
  "opcode": "Opcodes.gtype"
  "error out": error
types:
  "Opcodes.gtype" = u8
uses:
  WebSockets::WebSocket.gtype::Tick Count with Error Wires.gvi
  WebSockets::WebSocket.gtype::Socket Read.gvi
  NI::G Core::Error::Legacy::Error Cluster From Error Code.gvi
  WebSockets::WebSocket.gtype::Calculate Timeout.gvi
  WebSockets::WebSocket.gtype::DecodeMaskedBytes.gvi
diagram:
  case ($"error in") {
    frame No Error {
      call "Tick Count with Error Wires.gvi"(error in=$"error in") -> (error out=w6, millisecond timer value=w7)
      call "Socket Read.gvi"(webSocket in=$"webSockets in", # bytes to read=1, timeout ms=$"timeout ms", error in=w6) -> (webSocket out=w8, read bytes=w9, error out=w10)
      case (w10) {
        frame No Error {
          Array Index(array=w9) -> (out0[_]=w11)
          w12 = 15  # 0xF
          Logical And(w11, w12) -> w3
          case (w3) {
            frame Default {
              Format Into String(formatString="Opcode '%d' not supported.", errIn=w10, w3) -> (outString=w13, errOut=w14)
              call "Error Cluster From Error Code.gvi"(error code=1109, error message=w13, error in=w14) -> (error out=w2)
              w5 = w8
              w1 = default
            }
            frame 3..7, 11..15 {
              # 3-7: Reserved non-control frames
              # 11-15: Reserved control frames
              w5 = w8
              w1 = default
              w2 = w10
            }
            frame 0..2, 8..10 {
              w15 = 128  # 0x80
              call "Calculate Timeout.gvi"(t0=w7, timeout ms=$"timeout ms", error in=w10) -> (error out=w16, new timeout ms=w17)
              call "Socket Read.gvi"(webSocket in=w8, # bytes to read=1, timeout ms=w17, error in=w16) -> (webSocket out=w18, read bytes=w19, error out=w20)
              Array Index(array=w19) -> (out0[_]=w21)
              Logical And(w21, w15) -> w22
              Is Greater Than 0(x=w22) -> w23
              call "Calculate Timeout.gvi"(t0=w7, timeout ms=$"timeout ms", error in=w20) -> (error out=w24, new timeout ms=w25)
              w26 = 127  # 0x7F
              Logical And(w21, w26) -> w27
              case (w27) {  # Payload Length
                frame Default {
                  To Signed 32 Bit Integer(number=w27) -> w29
                  w28 = w18
                  w30 = w24
                }
                frame 126 {
                  call "Socket Read.gvi"(webSocket in=w18, # bytes to read=2, timeout ms=w25, error in=w24) -> (webSocket out=w28, read bytes=w31, error out=w30)
                  w32 = u16 0  # U16
                  Type Cast(type=w32, x=w31) -> w33
                  To Signed 32 Bit Integer(number=w33) -> w29
                }
                frame 127 {
                  call "Socket Read.gvi"(webSocket in=w18, # bytes to read=8, timeout ms=w25, error in=w24) -> (webSocket out=w28, read bytes=w34, error out=w30)
                  w35 = u64 0  # U64
                  Type Cast(type=w35, x=w34) -> w36
                  # if this number is larger than 2^31, can't deal with it.
                  To Signed 32 Bit Integer(number=w36) -> w29
                }
              }
              # 0 = continuation frame
              # 1 = text frame
              # 2 = binary frame
              # 8 = close
              # 9 = ping
              # 10 = pong
              case (w23) {  # Masked?
                frame True {
                  call "Calculate Timeout.gvi"(t0=w7, timeout ms=$"timeout ms", error in=w30) -> (error out=w38, new timeout ms=w39)
                  call "Socket Read.gvi"(webSocket in=w28, # bytes to read=4, timeout ms=w39, error in=w38) -> (webSocket out=w40, read bytes=w41, error out=w42)
                  call "Calculate Timeout.gvi"(t0=w7, timeout ms=$"timeout ms", error in=w42) -> (error out=w43, new timeout ms=w44)
                  call "Socket Read.gvi"(webSocket in=w40, # bytes to read=w29, timeout ms=w44, error in=w43) -> (webSocket out=w5, read bytes=w45, error out=w46)
                  call "DecodeMaskedBytes.gvi"(encoded data=w45, mask bytes=w41, error in=w46) -> (decoded data=w1, error out=w37)
                }
                frame False {
                  call "Calculate Timeout.gvi"(t0=w7, timeout ms=$"timeout ms", error in=w30) -> (error out=w47, new timeout ms=w48)
                  call "Socket Read.gvi"(webSocket in=w28, # bytes to read=w29, timeout ms=w48, error in=w47) -> (webSocket out=w5, read bytes=w1, error out=w37)
                }
              }
              case (w3) {
                frame Default {
                  w2 = w37
                }
                frame 8 {
                  call "Error Cluster From Error Code.gvi"(error code=6066, error message="Remote client sent connection close frame.", error in=w37) -> (error out=w2)
                }
              }
            }
          }
          Number To Boolean Array(number=w11) -> (Boolean array=w49)
          Array Index(array=w49) -> (out0[7]=w4)
        }
        frame Error {
          # Timeout/connection error occurred - return to application for handling.
          w5 = w8
          w1 = default
          w2 = w10
          w3 = 0
          w4 = TRUE
        }
      }
    }
    frame Error {
      w1 = default
      w2 = $"error in"
      w3 = 0
      w4 = TRUE
      w5 = $"webSockets in"
    }
  }
  $"webSockets out" <- w5
  $data <- w1
  $"error out" <- w2
  $opcode <- w3
  $"finished?" <- w4
