vi "Low-Level Write.gvi"   [LabVIEW NXG 4.0.0]
# Sends a WebSocket frame to the connection endpoint. Messages sent from the client must be masked but it is optional for the server.
# Finished should be set to True unless sending a fragmented message.
# WebSockets 2.0.1.40
# Sam Sharp - MediaMongrels Ltd
# Copyright (c) 2019, MediaMongrels Ltd
inputs:
  "mask payload?": bool
  "webSockets in": "WebSocket.gtype", required
  "data": u8[], required
  "timeout ms": i32 = 5000
  "error in": error
  "opcode": "Opcodes.gtype" = "Text"(1)
  "finished?": bool = TRUE
outputs:
  "webSockets out": "WebSocket.gtype"
  "error out": error
types:
  "Opcodes.gtype" = u8
uses:
  WebSockets::WebSocket.gtype::EncodeMaskedBytes.gvi
  WebSockets::WebSocket.gtype::DataLengthBytes.gvi
  WebSockets::WebSocket.gtype::Socket Write.gvi
diagram:
  case ($"error in") {
    frame No Error {
      case ($"mask payload?") {
        frame False, Default {
          w3 = $data
          w4 = $"error in"
        }
        frame True {
          call "EncodeMaskedBytes.gvi"(raw data=$data, error in=$"error in") -> (masked data=w3, error out=w4)
        }
      }
      call "DataLengthBytes.gvi"(data=w3, is masked?=$"mask payload?") -> (length bytes=w5)
      Select(s=$"finished?", t=128, f=0) -> w6
      Add($opcode, w6) -> w7
      Type Cast(type=u8 0, x=w7) -> w8
      Build Array(w8, w5, w3) -> w9
      call "Socket Write.gvi"(webSocket in=$"webSockets in", bytes to write=w9, timeout ms=$"timeout ms", error in=w4) -> (webSocket out=w2, error out=w1)
    }
    frame Error {
      w1 = $"error in"
      w2 = $"webSockets in"
    }
  }
  $"webSockets out" <- w2
  $"error out" <- w1
