vi "ProcessHandshakeRequest.gvi"   [LabVIEW NXG 4.0.0]
# Converts the raw HTTP header string into it's main component parts needed to check if the incoming connection is a WS connection. The additional headers are returned in a variant lookup table.
# WebSockets 2.0.1.40
# Sam Sharp - MediaMongrels Ltd
# Copyright (c) 2019, MediaMongrels Ltd
inputs:
  "webSocket in": "WebSocket.gtype", required
  "HTTP header": string, required
  "error in": error
outputs:
  "webSocket out": "WebSocket.gtype"
  "is websocket request?": bool
  "sec-webSocket-key": string
  "error out": error
  "host": string
uses:
  WebSockets::WebSocket.gtype::SplitHTTPHeaders.gvi
  WebSockets::WebSocket.gtype::Parse HTTP Header Line.gvi
  WebSockets::WebSocket.gtype::Set Return Header.gvi
  WebSockets::WebSocket.gtype::Read Return Header.gvi
diagram:
  case ($"error in") {
    frame No Error {
      call "SplitHTTPHeaders.gvi"(HTTP header string=$"HTTP header", error in=$"error in") -> (HTTP request=w6, headers array=w7, error out=w8)
      call "Parse HTTP Header Line.gvi"(webSocket in=$"webSocket in", HTTP header line=w6, error in=w8) -> (webSocket out=w9, error out=w10)
      # clear any existing return headers
      Property Node(instance in=w9, "Return Headers"=variant(), error in=w10) -> (error out=w11, instance out=w12)
      s1 = w12  # shift register
      s2 = w11  # shift register
      for {
        w13 = each element of w7
        Array Index(array=w13) -> (out0[_]=w14, out1[_]=w15)
        call "Set Return Header.gvi"(webSockets in=s1, name=w14, value=w15, error in=s2) -> (webSockets out=w16, error out=w17)
        next s1 = w16
        next s2 = w17
      }
      call "Read Return Header.gvi"(webSocket in=s1, name="Host", error in=s2) -> (webSocket out=w18, value=w1, found?=w19, error out=w20)
      call "Read Return Header.gvi"(webSocket in=w18, name="Sec-WebSocket-Key", error in=w20) -> (webSocket out=w21, value=w2, found?=w22, error out=w23)
      call "Read Return Header.gvi"(webSocket in=w21, name="Upgrade", error in=w23) -> (webSocket out=w3, value=w24, error out=w5)
      To Lower Case(string=w24) -> w25
      Is Equal(x="websocket", y=w25) -> w26
      Logical And(w19, w22, w26) -> w4
    }
    frame Error {
      w1 = default
      w2 = default
      w3 = $"webSocket in"
      w4 = default
      w5 = $"error in"
    }
  }
  $host <- w1
  $"sec-webSocket-key" <- w2
  $"is websocket request?" <- w4
  $"webSocket out" <- w3
  $"error out" <- w5
