vi "ProduceAcceptKey.gvi"   [LabVIEW NXG 4.0.0]
# Generates the WebSockets Accept key for the HTTP handshaking response. This is a base-64 encoding + SHA-1 of the received key and the WebSockets magic string.
# WebSockets 2.0.1.40
# Sam Sharp - MediaMongrels Ltd
# Copyright (c) 2019, MediaMongrels Ltd
inputs:
  "sec-webSocket-key": string, required
outputs:
  "sec-webSocket-accept": string
uses:
  WebSockets::WebSocket.gtype::SHA-1.gvi
  WebSockets::WebSocket.gtype::Util Convert to Base64.gvi
diagram:
  w1 = "258EAFA5-E914-47DA-95CA-C5AB0DC85B11"  # WebSockets Magic String
  Concatenate Strings($"sec-webSocket-key", w1) -> w2
  String To Byte Array(encoding="Extended ASCII", string=w2) -> (unsigned byte array=w3)
  call "SHA-1.gvi"(data=w3) -> (message-digest=w4)
  Byte Array To String(encoding="Extended ASCII", unsigned byte array=w4) -> (string=w5)
  call "Util Convert to Base64.gvi"(string=w5) -> (base64 string=w6)
  $"sec-webSocket-accept" <- w6
