vi "ReadHTTPHeader.gvi"   [LabVIEW NXG 4.0.0]
# Reads a HTTP header (ending in \r\n\r\n) from the Socket connection.
# WebSockets 2.0.1.40
# Sam Sharp - MediaMongrels Ltd
# Copyright (c) 2019, MediaMongrels Ltd
inputs:
  "webSocket in": "WebSocket.gtype", required
  "timeout ms": i32 = 25000
  "error in": error
outputs:
  "webSocket out": "WebSocket.gtype"
  "HTTP header": string
  "error out": error
uses:
  WebSockets::WebSocket.gtype::Tick Count with Error Wires.gvi
  WebSockets::WebSocket.gtype::Calculate Timeout.gvi
  WebSockets::WebSocket.gtype::Socket Read.gvi
  NI::G Core::Error::Clear Error Cluster.gvi
diagram:
  case ($"error in") {
    frame No Error {
      call "Tick Count with Error Wires.gvi"(error in=$"error in") -> (error out=w4, millisecond timer value=w5)
      s1 = ""  # shift register
      while {  # Read HTTP Headers
        call "Calculate Timeout.gvi"(t0=w5, timeout ms=$"timeout ms", error in=w4) -> (elapsed?=w6, error out=w7, new timeout ms=w8)
        call "Socket Read.gvi"(webSocket in=$"webSocket in", # bytes to read=1, timeout ms=w8, error in=w7) -> (webSocket out=w2, read bytes=w9, error out=w10)
        Byte Array To String(encoding="Extended ASCII", unsigned byte array=w9) -> (string=w11)
        Concatenate Strings(s1, w11) -> w12
        Search Or Split String(search string/char="\r\n\r\n", string=w12) -> (offset of match=w13)
        Is Greater Or Equal To 0(x=w13) -> w14
        # timeout but we got a valid HTTP header
        call "Clear Error Cluster.gvi"(error in=w10) -> (error out=w15)
        Select(s=w14, t=w15, f=w10) -> w1
        Logical Or(w14, w6) -> w16
        next s1 = w12
        stop if w16
      }
      w3 = s1
    }
    frame Error {
      w1 = $"error in"
      w2 = $"webSocket in"
      w3 = default
    }
  }
  $"webSocket out" <- w2
  $"error out" <- w1
  $"HTTP header" <- w3
