vi "Socket Read.gvi"   [LabVIEW NXG 4.0.0]
# Wrapper for the Socket Read function.
# WebSockets 2.0.1.40
# Sam Sharp - MediaMongrels Ltd
# Copyright (c) 2019, MediaMongrels Ltd
inputs:
  "webSocket in": "WebSocket.gtype", required
  "# bytes to read": i32, required
  "timeout ms": i32 = 5000
  "error in": error
outputs:
  "webSocket out": "WebSocket.gtype"
  "read bytes": u8[]
  "error out": error
uses:
  Sockets::Socket.gtype::Read.gvi
diagram:
  case ($"error in") {
    frame No Error {
      in-place {
        Unbundle Bundle Read Poser() -> ("Socket"=w4)
        call "Read.gvi"(socket in=w4, # bytes to read=$"# bytes to read", timeout ms=$"timeout ms", error in=$"error in") -> (socket out=w5, read bytes=w3, error out=w2)
        Unbundle Bundle Write Poser("Socket"=w5)
      }
    }
    frame Error {
      w1 = $"webSocket in"
      w2 = $"error in"
      w3 = default
    }
  }
  $"webSocket out" <- w1
  $"read bytes" <- w3
  $"error out" <- w2
