vi "Socket Write.gvi"   [LabVIEW NXG 4.0.0]
# Wrapper for the Socket Write function.
# WebSockets 2.0.1.40
# Sam Sharp - MediaMongrels Ltd
# Copyright (c) 2019, MediaMongrels Ltd
inputs:
  "webSocket in": "WebSocket.gtype", required
  "bytes to write": u8[], required
  "timeout ms": i32 = 5000
  "error in": error
outputs:
  "webSocket out": "WebSocket.gtype"
  "bytes written": i32
  "error out": error
uses:
  Sockets::Socket.gtype::Write.gvi
diagram:
  case ($"error in") {
    frame No Error {
      in-place {
        Unbundle Bundle Read Poser() -> ("Socket"=w4)
        call "Write.gvi"(socket in=w4, bytes to write=$"bytes to write", timeout ms=$"timeout ms", error in=$"error in") -> (socket out=w5, bytes written=w3, error out=w2)
        Unbundle Bundle Write Poser("Socket"=w5)
      }
    }
    frame Error {
      w1 = $"webSocket in"
      w2 = $"error in"
      w3 = default
    }
  }
  $"webSocket out" <- w1
  $"bytes written" <- w3
  $"error out" <- w2
