vi "SplitHTTPHeaders.gvi"   [LabVIEW NXG 4.0.0]
# Returns the remaining HTTP headers received from the client.
# WebSockets 2.0.1.40
# Sam Sharp - MediaMongrels Ltd
# Copyright (c) 2019, MediaMongrels Ltd
inputs:
  "HTTP header string": string, required
  "error in": error
outputs:
  "HTTP request": string
  "headers array": string[][]
  "error out": error
diagram:
  case ($"error in") {
    frame No Error {
      Spreadsheet String To Array(array type=string[][] [], delimiter=": ", format string="%s", spreadsheet string=$"HTTP header string") -> (array=w4)
      Array Index(array=w4) -> (out0[0, 0]=w2)
      Array Size(array=w4) -> (size(s)=w5)
      Array Index(array=w5) -> (out0[_]=w6)
      Subtract(x=w6, y=2) -> w7
      Array Subset(array=w4, index0=1, length0=w7) -> w1
      w3 = $"error in"
    }
    frame Error {
      w1 = string[][] []
      w2 = ""
      w3 = $"error in"
    }
  }
  $"HTTP request" <- w2
  $"headers array" <- w1
  $"error out" <- w3
