vi "Validate Supported Protocols.gvi"   [LabVIEW Conversion 4.0.0]
# Checks the headers for Sec-WebSocket-Protocol and if present, matches against the list of supported protocols specified by the server. If no protocols are supported, this VI will not return an error but the protocol will not returned.
# WebSockets 2.0.1.40
# Sam Sharp - MediaMongrels Ltd
# Copyright (c) 2019, MediaMongrels Ltd
inputs:
  "webSocket in": "WebSocket.gtype", required
  "error in": error
outputs:
  "webSocket out": "WebSocket.gtype"
  "error out": error
uses:
  WebSockets::WebSocket.gtype::Read Return Header.gvi
  NI::G Core::Error::Legacy::Error Cluster From Error Code.gvi
  WebSockets::WebSocket.gtype::Set Send Header.gvi
diagram:
  case ($"error in") {
    frame No Error {
      # these should be listed in order of preference
      Property Node(instance in=$"webSocket in", error in=$"error in") -> ("Protocols"=w3, error out=w4, instance out=w5)
      call "Read Return Header.gvi"(webSocket in=w5, name="Sec-WebSocket-Protocol", error in=w4) -> (webSocket out=w6, value=w7, error out=w8)
      Build Array(w7) -> w9
      Spreadsheet String To Array(array type=w9, delimiter=",", format string="%s", spreadsheet string=w7) -> (array=w10)
      Array Size(array=w3) -> (size(s)=w11)
      # no supported protocols specified - no error but do not return in header
      # supported protocols specified but not found in header - return error
      # supported protocols and found - return the received header
      case (w11) {
        frame 0 {
          # no supported protocols specified - allow any
          w1 = w6
          w2 = w8
        }
        frame Default {
          for {
            w12 = each element of w10
            Search 1D Array(1D array=w3, element=w12) -> (index of element=w13)
            Is Greater Or Equal To 0(x=w13) -> w14
            stop if w14
          }
          case (w14) {
            frame False, Default {
              Format Into String(formatString="Unsupported protocol (%s)", errIn=w8, w12) -> (outString=w15, errOut=w16)
              call "Error Cluster From Error Code.gvi"(error code=1, error message=w15, error in=w16) -> (error out=w2)
              w1 = w6
            }
            frame True {
              call "Set Send Header.gvi"(webSockets in=w6, name="Sec-WebSocket-Protocol", value=w12, error in=w8) -> (webSockets out=w1, error out=w2)
            }
          }
        }
      }
    }
    frame Error {
      w1 = $"webSocket in"
      w2 = $"error in"
    }
  }
  $"webSocket out" <- w1
  $"error out" <- w2
