vi "SHA-1 Core.gvi"   [LabVIEW Conversion 4.0.0]
# This VI contains the core of the MD5 algorithm.
# WebSockets 2.0.1.40
# Sam Sharp - MediaMongrels Ltd
# Copyright (c) 2019, MediaMongrels Ltd
inputs:
  "s1": u32 = 1732584193
  "s2": u32 = 4023233417
  "s3": u32 = 2562383102
  "s4": u32 = 271733878
  "s5": u32 = 271733878
  "input bytes": u8[]
outputs:
  "s1 out": u32
  "s2 out": u32
  "s3 out": u32
  "s4 out": u32
  "s5 out": u32
diagram:
  # process 64 bytes at a time
  Array Size(array=$"input bytes") -> (size(s)=w1)
  Quotient And Remainder(x=w1, y=64) -> (floor(x/y)=w2)
  # http://www.faqs.org/rfcs/rfc3174.html
  s1 = $s1  # shift register
  s2 = $s2  # shift register
  s3 = $s3  # shift register
  s4 = $s4  # shift register
  s5 = $s5  # shift register
  s6 = uninitialised  # shift register
  for (N = w2) (iteration -> i1) {
    Is First Call() -> w3
    case (w3) {
      frame False, Default {
        w4 = s6
      }
      frame True {
        Initialize Array(element=0, size=80) -> w4
      }
    }
    Multiply(i1, 64) -> w5
    Array Subset(array=$"input bytes", index0=w5, length0=64) -> w6
    # convert to U32
    Type Cast(type=u32[] [], x=w6) -> w7
    # >> W[80] >>
    # put 1st 16 values of input data into W[0..15]
    Array Subset(array=w7, index0=0, length0=16) -> w8
    Replace Array Subset(inArray=w4, index=0, new=w8) -> w9
    # fill rest of W buffer with derivatives of input data
    s7 = w9  # shift register
    for (N = 64) (iteration -> i2) {
      Add(16, i2) -> w10
      Subtract(x=w10, y=3) -> w11
      Subtract(x=w10, y=8) -> w12
      Subtract(x=w10, y=14) -> w13
      Subtract(x=w10, y=16) -> w14
      Array Index(array=s7) -> (out0[w11]=w15, out1[w12]=w16, out2[w13]=w17, out3[w14]=w18)
      Logical Exclusive Or(w15, w16) -> w19
      Logical Exclusive Or(w19, w17) -> w20
      Logical Exclusive Or(w20, w18) -> w21
      Rotate(x=w21, y=1) -> w22
      Replace Array Subset(inArray=s7, index=w10, new=w22) -> w23
      next s7 = w23
    }
    # SHA-1 main algorithm
    s8 = s1  # shift register
    s9 = s2  # shift register
    s10 = s3  # shift register
    s11 = s4  # shift register
    s12 = s5  # shift register
    s13 = s7  # shift register
    for (N = 80) (iteration -> i3) {
      Array Index(array=s13) -> (out0[i3]=w24)
      case (i3) {
        frame 0..19, Default {
          Logical And(s9, s10) -> w32
          Not(x=s9) -> w33
          Logical And(w33, s11) -> w34
          Logical Or(w32, w34) -> w30
          w25 = s8
          w26 = s9
          w27 = s10
          w28 = s11
          w29 = s12
          w31 = 0x5A827999
        }
        frame 20..39 {
          Logical Exclusive Or(s9, s10) -> w35
          Logical Exclusive Or(w35, s11) -> w30
          w25 = s8
          w26 = s9
          w27 = s10
          w28 = s11
          w29 = s12
          w31 = 0x6ED9EBA1
        }
        frame 40..59 {
          Logical And(s9, s10) -> w36
          Logical And(s9, s11) -> w37
          Logical Or(w36, w37) -> w38
          Logical And(s10, s11) -> w39
          Logical Or(w38, w39) -> w30
          w25 = s8
          w26 = s9
          w27 = s10
          w28 = s11
          w29 = s12
          w31 = 0x8F1BBCDC
        }
        frame 60..79 {
          Logical Exclusive Or(s9, s10) -> w40
          Logical Exclusive Or(w40, s11) -> w30
          w25 = s8
          w26 = s9
          w27 = s10
          w28 = s11
          w29 = s12
          w31 = 0xCA62C1D6
        }
      }
      Rotate(x=w25, y=5) -> w41
      Add(w41, w30, w29, w31, w24) -> w42
      Rotate(x=w26, y=30) -> w43
      next s8 = w42
      next s9 = w25
      next s10 = w43
      next s11 = w27
      next s12 = w28
    }
    Add(s8, s1) -> w44
    Add(s9, s2) -> w45
    Add(s10, s3) -> w46
    Add(s11, s4) -> w47
    Add(s12, s5) -> w48
    next s1 = w44
    next s2 = w45
    next s3 = w46
    next s4 = w47
    next s5 = w48
    next s6 = s13
  }
  $"s1 out" <- s1
  $"s2 out" <- s2
  $"s3 out" <- s3
  $"s4 out" <- s4
  $"s5 out" <- s5
