vi "SHA-1 Digest.gvi"   [LabVIEW Conversion 4.0.0]
# This VI performs certain bitwise operations on the state variables and converts them to hex strings such that they can be concatenated and displayed as the MD5 message-digest.
# WebSockets 2.0.1.40
# Sam Sharp - MediaMongrels Ltd
# Copyright (c) 2019, MediaMongrels Ltd
inputs:
  "s1": u32
  "s2": u32
  "s3": u32
  "s4": u32
  "s5": u32
outputs:
  "message-digest": u8[]
diagram:
  # convert U32's into array of 20 U8's = message digest
  # Big-endian (LabVIEW endian type - no byte swapping needed)
  Build Array($s1, $s2, $s3, $s4, $s5) -> w1
  Type Cast(type=u8[] [], x=w1) -> w2
  $"message-digest" <- w2
