vi "SHA-1 Pad.gvi"   [LabVIEW Conversion 4.0.0]
# This VI creates a new string that represents the padding for the message string.  The sum of the lengths of the message string and the padding string (in bytes) must be a multiple of 64.
# WebSockets 2.0.1.40
# Sam Sharp - MediaMongrels Ltd
# Copyright (c) 2019, MediaMongrels Ltd
inputs:
  "message length": i32
  "last part": u8[]
outputs:
  "padding": u8[]
diagram:
  # The last part of the string - that part which is beyond a 64-byte boundary -
  # becomes the first part of the padding.
  Quotient And Remainder(x=$"message length", y=64) -> (x-y*floor(x/y)=w1)
  # # bytes mod 64
  case (w1) {
    frame 56..63 {
      Subtract(x=120, y=w1) -> w2
    }
    frame 0..55, Default {
      Subtract(x=56, y=w1) -> w2
    }
  }
  Decrement(x=w2) -> w3
  Initialize Array(element=0, size=w3) -> w4
  To Unsigned 32 Bit Integer(number=$"message length") -> w5
  # x
  Rotate Left With Carry(carry=FALSE, value in=w5) -> (msb carry out=w6, value out=w7)
  Rotate Left With Carry(carry=FALSE, value in=w7) -> (msb carry out=w8, value out=w9)
  Rotate Left With Carry(carry=FALSE, value in=w9) -> (msb carry out=w10, value out=w11)
  # Convert # bytes (x) to # bits by shifting the three most significant bits of x into z.
  # The length of the message string in bits is now contained in five bytes:
  # the four least significant bytes in y; the most significant byte in z.
  # Insert y and z into the 64-bit length, MSB first.
  Rotate Left With Carry(carry=w6, value in=0) -> (value out=w12)
  Rotate Left With Carry(carry=w8, value in=w12) -> (value out=w13)
  Rotate Left With Carry(carry=w10, value in=w13) -> (value out=w14)
  # y
  Split Number(x=w11) -> (high(x)=w15, low(x)=w16)
  Split Number(x=w15) -> (high(x)=w17, low(x)=w18)
  # z
  Split Number(x=w16) -> (high(x)=w19, low(x)=w20)
  Build Array(w20, w19, w18, w17, w14, 0, 0, 0) -> w21
  # 64-bit (8-byte) length
  Reverse 1D Array(array=w21) -> (reversed array=w22)
  Build Array($"last part", 128, w4, w22) -> w23
  $padding <- w23
