vi "SHA-1 Test.gvi"   [LabVIEW NXG 4.0.0]
# WebSockets 2.0.1.40
# Sam Sharp - MediaMongrels Ltd
# Copyright (c) 2019, MediaMongrels Ltd
panel controls:
  "string": string
panel indicators:
  "SHA1 data": u8[]
uses:
  WebSockets::WebSocket.gtype::SHA-1.gvi
diagram:
  String To Byte Array(encoding="UTF-8", string=$string) -> (unsigned byte array=w1)
  call "SHA-1.gvi"(data=w1) -> (message-digest=w2)
  $"SHA1 data" <- w2
