vi "SHA-1.gvi"   [LabVIEW Conversion 4.0.0]
# WebSockets 2.0.1.40
# Sam Sharp - MediaMongrels Ltd
# Copyright (c) 2019, MediaMongrels Ltd
inputs:
  "data": u8[]
outputs:
  "message-digest": u8[]
uses:
  WebSockets::WebSocket.gtype::SHA-1 Core.gvi
  WebSockets::WebSocket.gtype::SHA-1 Pad.gvi
  WebSockets::WebSocket.gtype::SHA-1 Digest.gvi
diagram:
  call "SHA-1 Core.gvi"(s1=0x67452301, s2=0xEFCDAB89, s3=0x98BADCFE, s4=0x10325476, s5=0xC3D2E1F0, input bytes=$data) -> (s1 out=w1, s2 out=w2, s3 out=w3, s4 out=w4, s5 out=w5)
  Array Size(array=$data) -> (size(s)=w6)
  Quotient And Remainder(x=w6, y=64) -> (x-y*floor(x/y)=w7)
  Subtract(x=w6, y=w7) -> w8
  Array Subset(array=$data, index0=w8) -> w9
  call "SHA-1 Pad.gvi"(message length=w6, last part=w9) -> (padding=w10)
  call "SHA-1 Core.gvi"(s1=w1, s2=w2, s3=w3, s4=w4, s5=w5, input bytes=w10) -> (s1 out=w11, s2 out=w12, s3 out=w13, s4 out=w14, s5 out=w15)
  call "SHA-1 Digest.gvi"(s1=w11, s2=w12, s3=w13, s4=w14, s5=w15) -> (message-digest=w16)
  $"message-digest" <- w16
