vi "Util Convert From Base64 and Store.gvi"   [LabVIEW NXG 4.0.0]
# This VI converts a Base 64 string to its string equivalent. Base64 strings are commonly used in Internet protocols  such as HTTP, SMTP, etc.
# WebSockets 2.0.1.40
# Sam Sharp - MediaMongrels Ltd
# Copyright (c) 2019, MediaMongrels Ltd
inputs:
  "base64 string": string
  "write to file": bool
  "file path": path
  "error in": error
outputs:
  "string": string
  "error out": error
diagram:
  Search And Replace String(error in (no error)=$"error in", input string=$"base64 string", replace all (F)=TRUE, replace string ("")="", search string="\r") -> (error out=w1, result string=w2)
  # Remove characters that may be
  # introduced into the string by
  # copy/paste operations
  Search And Replace String(error in (no error)=w1, input string=w2, replace all (F)=TRUE, replace string ("")="", search string="\n") -> (error out=w3, result string=w4)
  Search And Replace String(error in (no error)=w3, input string=w4, replace all (F)=TRUE, replace string ("")="", search string=" ") -> (error out=w5, result string=w6)
  w7 = "ABCDEFGHIJKLMNOPQRSTUVWXYZabcdefghijklmnopqrstuvwxyz0123456789+/"
  Match Pattern(regular expression="=", string=w6) -> (before substring=w8)
  String Length(string=w8) -> (length=w9)
  s1 = bool[] []  # shift register
  for (N = w9) (iteration -> i1) {
    String Subset(length (rest)=1, offset (0)=i1, string=w8) -> w10
    Match Pattern(regular expression=w10, string=w7) -> (offset past match=w11)
    Decrement(x=w11) -> w12
    Number To Boolean Array(number=w12) -> (Boolean array=w13)
    Array Subset(array=w13, length0=6) -> w14
    Reverse 1D Array(array=w14) -> (reversed array=w15)
    Build Array(s1, w15) -> w16
    next s1 = w16
  }
  Array Size(array=s1) -> (size(s)=w17)
  Quotient And Remainder(x=w17, y=8) -> (floor(x/y)=w18)
  for (N = w18) (iteration -> i2) {
    Multiply(i2, 8) -> w20
    Array Subset(array=s1, index0=w20, length0=8) -> w21
    Reverse 1D Array(array=w21) -> (reversed array=w22)
    Boolean Array To Number[SignExtensionMode=1](Boolean array=w22) -> (number=w23)
    To Unsigned 8 Bit Integer(number=w23) -> w24
    append w24 to w19
  }
  Byte Array To String(encoding="UTF-8", unsigned byte array=w19) -> (string=w25)
  case ($"write to file") {
    frame False, Default {
      w26 = w5
    }
    frame True {
      Open Or Create Or Replace File(error in=w5, file path (use dialog)=$"file path", operation (0:open)="replace or create") -> (error out=w27, refnum out=w28)
      Write To Text File(error in=w27, file (use dialog)=w28, text=w25) -> (error out=w29, refnum out=w30)
      Close File(error in=w29, refnum=w30) -> (error out=w26)
    }
  }
  $"error out" <- w26
  $string <- w25
