vi "Util Convert to Base64.gvi"   [LabVIEW NXG 4.0.0]
# This VI converts a string to its Base64 equivalent. Base64 strings are commonly used in Internet protocols  such as HTTP, SMTP, etc.
# WebSockets 2.0.1.40
# Sam Sharp - MediaMongrels Ltd
# Copyright (c) 2019, MediaMongrels Ltd
inputs:
  "string": string
outputs:
  "base64 string": string
diagram:
  String To Byte Array(encoding="Extended ASCII", string=$string) -> (unsigned byte array=w1)
  s1 = bool[] []  # shift register
  for {
    w2 = each element of w1
    Number To Boolean Array(number=w2) -> (Boolean array=w3)
    Reverse 1D Array(array=w3) -> (reversed array=w4)
    Build Array(s1, w4) -> w5
    next s1 = w5
  }
  Array Size(array=s1)
  w6 = "ABCDEFGHIJKLMNOPQRSTUVWXYZabcdefghijklmnopqrstuvwxyz0123456789+/"
  Array Size(array=s1) -> (size(s)=w7)
  Quotient And Remainder(x=w7, y=6) -> (x-y*floor(x/y)=w8)
  case (w8) {
    frame 0 {
      w9 = bool[] []
    }
    frame 1, Default {
      Subtract(x=6, y=w8) -> w10
      Initialize Array(element=FALSE, size=w10) -> w9
    }
  }
  Build Array(s1, w9) -> w11
  Array Size(array=w11) -> (size(s)=w12)
  Divide(x=w12, y=6) -> w13
  s2 = ""  # shift register
  for (N = w13) (iteration -> i1) {
    Multiply(6, i1) -> w14
    Array Subset(array=w11, index0=w14, length0=6) -> w15
    Reverse 1D Array(array=w15) -> (reversed array=w16)
    Boolean Array To Number(Boolean array=w16) -> (number=w17)
    String Subset(length (rest)=1, offset (0)=w17, string=w6) -> w18
    Concatenate Strings(s2, w18) -> w19
    next s2 = w19
  }
  String Length(string=s2) -> (length=w20)
  Quotient And Remainder(x=w20, y=4) -> (x-y*floor(x/y)=w21)
  case (w21) {
    frame 0 {
      w22 = ""
    }
    frame 1, Default {
      # You should never
      # get to this case. If
      # you do there is a bug
      # in the rest of the algorithm.
      w22 = "Error"
    }
    frame 2 {
      w22 = "=="
    }
    frame 3 {
      w22 = "="
    }
  }
  Concatenate Strings(s2, w22) -> w23
  $"base64 string" <- w23
