vi "Write Text.gvi"   [LabVIEW NXG 4.0.0]
# Writes a text frame to the WebSocket connection endpoint.
# WebSockets 2.0.1.40
# Sam Sharp - MediaMongrels Ltd
# Copyright (c) 2019, MediaMongrels Ltd
inputs:
  "webSocket in": "WebSocket.gtype"
  "string data": string, required
  "timeout ms": i32 = 5000
  "error in": error
outputs:
  "webSocket out": "WebSocket.gtype"
  "error out": error
uses:
  WebSockets::WebSocket.gtype::Low-Level Write.gvi
diagram:
  Property Node(instance in=$"webSocket in", error in=$"error in") -> ("Is Server"=w1, error out=w2, instance out=w3)
  String To Byte Array(encoding="UTF-8", string=$"string data") -> (unsigned byte array=w4)
  Not(x=w1) -> w5
  call "Low-Level Write.gvi"(mask payload?=w5, webSockets in=w3, data=w4, timeout ms=$"timeout ms", error in=w2, opcode="Text"(1), finished?=TRUE) -> (webSockets out=w6, error out=w7)
  $"webSocket out" <- w6
  $"error out" <- w7
