vi "Join Strings.gvi"   [LabVIEW Conversion 4.0.0]
# Joins the elements of Strings In separating them with Separator.
# Separator - The item to put between each string.
# Strings In - The strings to join.
# String - The resultant joined string.
inputs:
  "strings in": string[], required
  "separator": string = ","
outputs:
  "string": string
diagram:
  Delete From Array(inArray=$"strings in") -> (outArray=w1, deleted=w2)
  Array Size(array=w1) -> (size(s)=w3)
  Initialize Array(element=$separator, size=w3) -> w4
  Interleave Array(w1, w4) -> w5
  Concatenate Strings(w5, w2) -> w6
  $string <- w6
